# Grasshopper definition PRUEBA 1 SOLO PYHTON - copia.gh (Grasshopper 1.0.8)
# plug-ins: opennest_2 Info

list = ValueList({"OSB 9mm": 9, "OSB 12mm": 12, "Terciado Estructural 15mm": 15, "Terciado Estructural 18mm": 18}, selected="Terciado Estructural 18mm")
multiplication = Multiplication(A=list, B=Slider(2.77, range=0..10))
py3 = Python3Script(
    T=list,
    C=Slider(0.5, range=0..1),
    L_core=Slider(750, range=0..1000),
    L_mid=Slider(120, range=0..1000),
    W_mid=Slider(185, range=0..1000),
    W_top=Slider(150, range=0..1000),
    W_notch=Slider(137, range=0..1000),
    W_tab=multiplication,
    W_sacado=Slider(10, range=0..1000),
    D_sacado=Slider(6, range=0..1000))  # -> out, a, b; inputs T: Double, C: Double, L_core: Double, W_mid: Double, W_top: Double, W_notch: Double, W_tab: Double
# ---------- py3: Python ----------
import rhinoscriptsyntax as rs

# ==========================================
# 1. PERÍMETRO ORIGINAL (Validado y Estable)
# ==========================================
pt0 = [0, (L_core/2) + T, 0]                            
pt1 = [W_tab/2, (L_core/2) + T, 0]                      
pt2 = [W_tab/2, (L_core/2) - D_sacado, 0]               
pt3 = [(W_tab/2) + W_sacado, (L_core/2) - D_sacado, 0]  
pt4 = [(W_tab/2) + W_sacado, L_core/2, 0]               
pt5 = [W_top/2, L_core/2, 0]                            
pt6 = [W_top/2, (L_mid/2) + T + C, 0]                   
pt7 = [W_notch/2, (L_mid/2) + T + C, 0]                 
pt8 = [W_notch/2, L_mid/2, 0]                           
pt9 = [W_mid/2, L_mid/2, 0]                             
pt10 = [W_mid/2, 0, 0]                                  

cuadrante_1 = [pt0, pt1, pt2, pt3, pt4, pt5, pt6, pt7, pt8, pt9, pt10]

cuadrante_4 = []
for pt in reversed(cuadrante_1[:-1]):
    cuadrante_4.append([pt[0], -pt[1], 0])
mitad_derecha = cuadrante_1 + cuadrante_4

mitad_izquierda = []
for pt in reversed(mitad_derecha):
    mitad_izquierda.append([-pt[0], pt[1], 0])

puntos_totales = mitad_derecha + mitad_izquierda[1:-1]
puntos_totales.append(puntos_totales[0]) 

perimetro = rs.AddPolyline(puntos_totales)

# ==========================================
# 2. SALIDA A GRASSHOPPER
# ==========================================
a = perimetro
# ---------- end py3 ----------
diámetro_de_fresa_cnc_mm = Slider(12, range=2..20)
Z = UnitZ(Factor=list)
n_piezas = Slider(3, range=0..100)
boundary = BoundarySurfaces(Edges=[py3.a, py3.b])
rectangle = Rectangle(Plane=PlaneXY(0, 0, 0), XSize=Slider(2440, range=0..10000), YSize=Slider(1220, range=0..10000), Radius=0)  # -> Rectangle, Length
boundary_2 = BoundarySurfaces(Edges=rectangle.Rectangle)
area = Area(Geometry=boundary)  # -> Area, Centroid
dup = DuplicateData(Data=boundary, Number=n_piezas, Order=True)
extr = Extrude(Base=boundary, Direction=Z)
panel = Panel("AREA PLANCHA")
opennest1 = OpenNest1(
    Sheets=boundary_2,
    Geo=dup,
    Spacing=diámetro_de_fresa_cnc_mm,
    Placement=1,
    Tolerance=0.1,
    Rotations=4,
    Iterations=6,
    Seed=1,
    Reset=False,
    Run=Toggle(True))  # -> Sheets, Geo, ID, Transform, IDS
Y = UnitY(Factor=Slider(1812, range=-2000..3000))
division = Division(A=area.Area, B="2970000")
move = Move(Geometry=boundary, Motion=Y)  # -> Geometry, Transform
# AREA QUE ACUPA PIEZA
panel_2 = Panel(division)
lng = ListLength(List=opennest1.Sheets)
edges = BrepEdges(Brep=opennest1.Geo)  # -> Naked, Interior, NonManifold
panel_3 = Panel("VALOR PLANCHA")
multiplication_2 = Multiplication(A="35000", B=panel_2)
multiplication_3 = Multiplication(A=lng, B="35000")
flatten = FlattenTree(Tree=edges.Naked, Path="{0}")
panel_4 = Panel("INDICA VALOR TOTAL")
py3_2 = Python3Script(Curvas=flatten, Ruta="C:/Users/janth/OneDrive/Escritorio/PIEZAS.dxf", Exportar=Button())  # -> out, a; inputs Curvas: list of GeometryBase
# ---------- py3_2: Python ----------
import os
import rhinoscriptsyntax as rs
import scriptcontext as sc
import Rhino

if "Exportar" in locals() and Exportar == True:
    if "Curvas" not in locals() or not Curvas:
        print("Error: Falta conectar el cable de las Curvas.")
    elif "Ruta" not in locals() or not Ruta:
        print("Error: Falta conectar el cable de la Ruta.")
    else:
        # 1. Limpiar el texto del panel por si hay espacios invisibles
        texto_ruta = str(Ruta).replace('\n', '').replace('\r', '').strip().replace('\\', '/')
        if not texto_ruta.lower().endswith('.dxf'):
            texto_ruta += '.dxf'

        # 2. SEPARAMOS LA CARPETA DEL NOMBRE DEL ARCHIVO
        carpeta = os.path.dirname(texto_ruta)
        nombre_archivo = os.path.basename(texto_ruta)

        # Verificar que la carpeta del panel realmente exista en tu PC
        if not os.path.exists(carpeta):
            print(f"Error: La carpeta no existe. Revisa que esté bien escrita:\n{carpeta}")
        else:
            sc.doc = Rhino.RhinoDoc.ActiveDoc
            rs.UnselectAllObjects()

            geometrias = Curvas if isinstance(Curvas, list) else [Curvas]
            ids_creados = []

            for geo in geometrias:
                if geo:
                    obj_id = sc.doc.Objects.Add(geo)
                    if obj_id:
                        ids_creados.append(obj_id)

            if ids_creados:
                rs.SelectObjects(ids_creados)
                sc.doc.Views.Redraw()

                # Borrar versión anterior para evitar que Rhino pregunte si deseas sobreescribir
                if os.path.exists(texto_ruta):
                    try:
                        os.remove(texto_ruta)
                    except Exception:
                        pass

                # 3. EL TRUCO: Cambiamos el directorio de trabajo de Rhino a tu escritorio
                rs.WorkingFolder(carpeta)

                # 4. Le damos la orden usando SOLO el nombre corto (igual que cuando funcionó con "true")
                cmd = f'! _-Export "{nombre_archivo}" _Enter _Enter'
                rs.Command(cmd, False)

                # Limpieza de la pantalla
                for i in ids_creados:
                    sc.doc.Objects.Delete(i, True)
                
                rs.UnselectAllObjects()
                sc.doc.Views.Redraw()

                # 5. Comprobación final
                if os.path.exists(texto_ruta):
                    print(f"¡AHORA SÍ!\nTu archivo está guardado en:\n{texto_ruta}")
                else:
                    print("Error: Rhino canceló. Presiona la tecla ESC 3 veces en Rhino y reintenta.")
            else:
                print("Error: Las curvas conectadas no son válidas.")
else:
    print("En reposo. Pulsa el botón para exportar.")
# ---------- end py3_2 ----------
panel_5 = Panel(multiplication_3)
panel_6 = Panel(multiplication_2)
panel_7 = Panel("VALOR DE PIEZA ")
join = JoinCurves(Curves=flatten, Preserve=False)
panel_8 = Panel(py3_2.out)
area_2 = Area(Geometry=join)  # -> Area, Centroid
ma = MassAddition(Input=flatten(area_2.Area))  # -> Result, PartialResults
multiplication_4 = Multiplication(A=lng, B="2.97")
panel_9 = Panel(multiplication_4)
multiplication_5 = Multiplication(A=lng, B="2.97")
division_2 = Division(A=ma.Result, B="1000000")
division_3 = Division(A="35000", B="2.97")
# PRECIO POR M2 DE PLANCHA
panel_10 = Panel(division_3)
# M2 NETOS DE LAS PIEZAS
panel_11 = Panel(division_2)
division_4 = Division(A=division_2, B=multiplication_5)
multiplication_6 = Multiplication(A=division_4, B="100")
multiplication_7 = Multiplication(A=panel_10, B=panel_11)
panel_12 = Panel(multiplication_6)
panel_13 = Panel("EFICIENCIA PLANCHA")
panel_14 = Panel("PRECIO DE PIEZAS")
panel_15 = Panel(multiplication_7)
subtraction = Subtraction(A=panel_5, B=multiplication_7)
py3_3 = Python3Script(
    Exportar=Button(),
    Ruta="C:/Users/janth/OneDrive/Escritorio/PIEZAS.dxf",
    Planchas=lng,
    CostoCompra=panel_5,
    CostoMerma=subtraction,
    Eficiencia=multiplication_6,
    AreaPlancha="2970000",
    Espesor=Slider(15, range=1..30))  # -> out, a; inputs Exportar: list of Boolean, Ruta: String
# ---------- py3_3: Python ----------
import os
import csv
from datetime import datetime

if "Exportar" in locals() and Exportar:
    if not Ruta:
        print("Error: Falta conectar la ruta.")
    else:
        ruta_str = str(Ruta).strip().strip('"').replace('\\', '/')
        ruta_csv = ruta_str.rsplit('.', 1)[0] + "_DATOS.csv"
        
        file_exists = os.path.isfile(ruta_csv)
        
        try:
            with open(ruta_csv, mode='a', newline='') as file:
                writer = csv.writer(file, delimiter=';') 
                
                # TÍTULOS: Se agrega la columna de Huella de Carbono
                if not file_exists:
                    writer.writerow(['Fecha y Hora', 'Planchas Usadas', 'Costo Compra (CLP)', 'Costo Merma (CLP)', 'Eficiencia (%)', 'CO2 Emitido por Merma (kg)'])
                
                fecha = datetime.now().strftime("%Y-%m-%d %H:%M")
                
                v_planchas = float(Planchas[0]) if isinstance(Planchas, list) else float(Planchas)
                v_compra = float(CostoCompra[0]) if isinstance(CostoCompra, list) else float(CostoCompra)
                v_merma = float(CostoMerma[0]) if isinstance(CostoMerma, list) else float(CostoMerma)
                v_eficiencia = float(Eficiencia[0]) if isinstance(Eficiencia, list) else float(Eficiencia)
                
                # --- MOTOR DE CÁLCULO AMBIENTAL ---
                v_co2 = 0.0
                if "AreaPlancha" in locals() and AreaPlancha and "Espesor" in locals() and Espesor:
                    v_area_plancha = float(AreaPlancha[0]) if isinstance(AreaPlancha, list) else float(AreaPlancha)
                    v_espesor = float(Espesor[0]) if isinstance(Espesor, list) else float(Espesor)
                    
                    # 1. Área total usada en m2 (el panel viene en mm2, lo dividimos por 1 millón)
                    area_total_m2 = (v_area_plancha / 1000000) * v_planchas
                    
                    # 2. Área de merma en m2 (el porcentaje ineficiente)
                    area_merma_m2 = area_total_m2 * (1 - (v_eficiencia / 100))
                    
                    # 3. Volumen de merma en m3 (el espesor viene en mm, lo dividimos por mil)
                    volumen_merma_m3 = area_merma_m2 * (v_espesor / 1000)
                    
                    # 4. Masa y Factor de Emisión (600 kg/m3 de densidad * 1.6 factor CO2)
                    masa_kg = volumen_merma_m3 * 600
                    v_co2 = masa_kg * 1.6
                
                # Ajuste de formatos (puntos por comas para el Excel chileno)
                str_planchas = str(round(v_planchas, 2)).replace('.', ',')
                str_compra = str(round(v_compra, 0)).replace('.', ',')
                str_merma = str(round(v_merma, 0)).replace('.', ',')
                str_eficiencia = str(round(v_eficiencia, 2)).replace('.', ',')
                str_co2 = str(round(v_co2, 2)).replace('.', ',')
                
                # Escribimos la fila completa con el dato ambiental
                writer.writerow([
                    fecha, 
                    str_planchas,
                    str_compra, 
                    str_merma, 
                    str_eficiencia,
                    str_co2
                ])
                
            print(f"¡CÁLCULO AMBIENTAL INTEGRADO!\nDatos guardados en:\n{ruta_csv}")
        except Exception as e:
            print(f"Error detallado: {e}")
else:
    print("En reposo. Pulsa el botón para registrar los datos.")
# ---------- end py3_3 ----------
panel_16 = Panel(py3_3.out)
panel_17 = Panel(subtraction)
panel_18 = Panel("COSTO MERMA")
