# Grasshopper definition PRUEBA 3.gh (Grasshopper 1.0.8)
# plug-ins: opennest_2 Info

panel = Panel("ALTO")
panel_2 = Panel("ANCHO VIGAS")
panel_3 = Panel("FRESA")
panel_4 = Panel("ESPESOR")
number_slider = Slider(23, range=0..100)
number_slider_2 = Slider(0.1, range=0..1)
number_slider_3 = Slider(3, range=0..100)
number_slider_4 = Slider(100, range=0..1000)
Z = UnitZ(Factor=number_slider_3)
Y = UnitY(Factor=1)
X = UnitX(Factor=1)
X_2 = UnitX(Factor=1)
Y_2 = UnitY(Factor=1)
n_piezas = Slider(1, range=0..50)
py3 = Python3Script(
    L3=Slider(144, range=0..1000),
    A_viga=number_slider,
    T=number_slider_3,
    C=number_slider_3,
    Prof_Sacado=Slider(8, range=0..10),
    Ancho_Sacado=Slider(5, range=0..10))  # -> out, Geo; inputs L3: Double, A_viga: Double, T: Double, C: Double, Prof_Sacado: Double, Ancho_Sacado: Double
# ---------- py3: Python ----------
import Rhino.Geometry as rg

# ESCUDO ANTI-ERRORES
try: L3 = L3
except NameError: L3 = 300.0

try: A_viga = A_viga
except NameError: A_viga = 40.0

try: T = T
except NameError: T = 3.0

try: C = C
except NameError: C = 0.1

try: Prof_Sacado = Prof_Sacado
except NameError: Prof_Sacado = 8.0

try: Ancho_Sacado = Ancho_Sacado
except NameError: Ancho_Sacado = 15.0

# ---------------------------------------------------------
# VARIABLES SECUNDARIAS
# ---------------------------------------------------------
notch_w = abs(Ancho_Sacado)   
notch_d = abs(Prof_Sacado)    

# Dimensiones de la espiga en ambos extremos
h_espiga = (A_viga * 0.4) - C 
prof_espiga = T               

# ---------------------------------------------------------
# CONSTRUCCIÓN DEL PERÍMETRO (Simétrico)
# ---------------------------------------------------------
pts = []

# 1. Esquina superior izquierda (justo antes de la espiga)
pts.append(rg.Point3d(-L3/2, A_viga/2, 0))

# 2. BORDE IZQUIERDO (Espiga hacia afuera)
pts.append(rg.Point3d(-L3/2, h_espiga/2, 0))
pts.append(rg.Point3d(-L3/2 - prof_espiga, h_espiga/2, 0))     # Sale
pts.append(rg.Point3d(-L3/2 - prof_espiga, -h_espiga/2, 0))    # Baja
pts.append(rg.Point3d(-L3/2, -h_espiga/2, 0))                  # Entra
pts.append(rg.Point3d(-L3/2, -A_viga/2, 0))

# 3. BORDE INFERIOR (Con sacado rectangular al centro, de izquierda a derecha)
pts.append(rg.Point3d(-notch_w/2, -A_viga/2, 0))              
pts.append(rg.Point3d(-notch_w/2, -A_viga/2 + notch_d, 0))   # Sube hacia adentro
pts.append(rg.Point3d(notch_w/2, -A_viga/2 + notch_d, 0))    # Cruce horizontal
pts.append(rg.Point3d(notch_w/2, -A_viga/2, 0))              # Baja al borde
pts.append(rg.Point3d(L3/2, -A_viga/2, 0))

# 4. BORDE DERECHO (Espiga simétrica hacia afuera)
pts.append(rg.Point3d(L3/2, -h_espiga/2, 0))
pts.append(rg.Point3d(L3/2 + prof_espiga, -h_espiga/2, 0))     # Sale
pts.append(rg.Point3d(L3/2 + prof_espiga, h_espiga/2, 0))      # Sube
pts.append(rg.Point3d(L3/2, h_espiga/2, 0))                    # Entra
pts.append(rg.Point3d(L3/2, A_viga/2, 0))

# 5. BORDE SUPERIOR (Con sacado rectangular al centro, de derecha a izquierda)
pts.append(rg.Point3d(notch_w/2, A_viga/2, 0))               
pts.append(rg.Point3d(notch_w/2, A_viga/2 - notch_d, 0))     # Baja hacia adentro
pts.append(rg.Point3d(-notch_w/2, A_viga/2 - notch_d, 0))    # Cruce horizontal
pts.append(rg.Point3d(-notch_w/2, A_viga/2, 0))              # Sube al borde

# 6. Cerramos cerrando el bucle con el primer punto
pts.append(pts[0])

contorno = rg.Polyline(pts).ToNurbsCurve()

# ---------------------------------------------------------
# EXPORTAR COMO SUPERFICIE SÓLIDA (Para OpenNest)
# ---------------------------------------------------------
superficie_solida = rg.Brep.CreatePlanarBreps([contorno], 0.01)

if superficie_solida:
    Geo = superficie_solida[0]
else:
    Geo = contorno
# ---------- end py3 ----------
panel_5 = Panel("HORIZONTAL LARGO")
py3_2 = Python3Script(
    L=Slider(150, range=0..1000),
    A=number_slider_4,
    T=number_slider_3,
    C=number_slider_2,
    D_ranuras=Slider(30, range=0..1000),
    Num_Corbatas_X=Slider(2, range=0..10),
    Num_Corbatas_Y=Slider(2, range=0..10),
    Num_Encajes_Y=Slider(1, range=0..10))  # -> out, Geo; inputs L: Double, A: Double, T: Double, D_ranuras: Double, Num_Corbatas_X: Int32, Num_Corbatas_Y: Int32, Num_Encajes_Y: Int32
# ---------- py3_2: Python ----------
import Rhino.Geometry as rg

# Asignar valores por defecto para corte láser
if L is None: L = 150.0
if A is None: A = 100.0
if T is None: T = 3.0
if C is None: C = 0.1
if Num_Corbatas_X is None: Num_Corbatas_X = 2
if Num_Corbatas_Y is None: Num_Corbatas_Y = 1
if Num_Encajes_Y is None: Num_Encajes_Y = 2

# ---------------------------------------------------------
# VARIABLES SECUNDARIAS
# ---------------------------------------------------------
bt_depth = 8.0           
bt_head = 12.0 + C       
bt_neck = 7.0 + C        
largo_corte = 15.0       

# ---------------------------------------------------------
# DISTRIBUCIÓN MATEMÁTICA
# ---------------------------------------------------------
centers_x = []
if Num_Corbatas_X > 0:
    segmento_x = L / Num_Corbatas_X
    for i in range(Num_Corbatas_X):
        cx = -L/2 + (segmento_x / 2) + (i * segmento_x)
        centers_x.append(cx)

features_y = []
total_lateral = Num_Corbatas_Y + Num_Encajes_Y

if total_lateral > 0:
    spacing_y = A / (total_lateral + 1)
    
    n_e = Num_Encajes_Y
    n_c = Num_Corbatas_Y
    
    mitad_superior = []
    while n_e >= 2:
        mitad_superior.append('encaje')
        n_e -= 2
    while n_c >= 2:
        mitad_superior.append('corbata')
        n_c -= 2
        
    centro = []
    if n_e == 1: centro.append('encaje')
    if n_c == 1: centro.append('corbata')
    
    tipos_lateral = mitad_superior + centro + list(reversed(mitad_superior))
    
    for i, tipo in enumerate(tipos_lateral):
        cy = A/2 - (i + 1) * spacing_y
        features_y.append({'y': cy, 'type': tipo})

# ---------------------------------------------------------
# 1. CONSTRUCCIÓN DEL CONTORNO
# ---------------------------------------------------------
pts = []
pts.append(rg.Point3d(-L/2, A/2, 0))

for cx in centers_x:
    pts.append(rg.Point3d(cx - bt_head/2, A/2, 0))
    pts.append(rg.Point3d(cx - bt_neck/2, A/2 - bt_depth/2, 0))
    pts.append(rg.Point3d(cx - bt_head/2, A/2 - bt_depth, 0))
    pts.append(rg.Point3d(cx + bt_head/2, A/2 - bt_depth, 0))
    pts.append(rg.Point3d(cx + bt_neck/2, A/2 - bt_depth/2, 0))
    pts.append(rg.Point3d(cx + bt_head/2, A/2, 0))

pts.append(rg.Point3d(L/2, A/2, 0))

for feat in features_y:
    cy = feat['y']
    if feat['type'] == 'corbata':
        pts.append(rg.Point3d(L/2, cy + bt_head/2, 0))
        pts.append(rg.Point3d(L/2 - bt_depth/2, cy + bt_neck/2, 0))
        pts.append(rg.Point3d(L/2 - bt_depth, cy + bt_head/2, 0))
        pts.append(rg.Point3d(L/2 - bt_depth, cy - bt_head/2, 0))
        pts.append(rg.Point3d(L/2 - bt_depth/2, cy - bt_neck/2, 0))
        pts.append(rg.Point3d(L/2, cy - bt_head/2, 0))
    elif feat['type'] == 'encaje':
        pts.append(rg.Point3d(L/2, cy + largo_corte/2, 0))
        pts.append(rg.Point3d(L/2 - T, cy + largo_corte/2, 0))
        pts.append(rg.Point3d(L/2 - T, cy - largo_corte/2, 0))
        pts.append(rg.Point3d(L/2, cy - largo_corte/2, 0))

pts.append(rg.Point3d(L/2, -A/2, 0))

for cx in reversed(centers_x):
    pts.append(rg.Point3d(cx + bt_head/2, -A/2, 0))
    pts.append(rg.Point3d(cx + bt_neck/2, -A/2 + bt_depth/2, 0))
    pts.append(rg.Point3d(cx + bt_head/2, -A/2 + bt_depth, 0))
    pts.append(rg.Point3d(cx - bt_head/2, -A/2 + bt_depth, 0))
    pts.append(rg.Point3d(cx - bt_neck/2, -A/2 + bt_depth/2, 0))
    pts.append(rg.Point3d(cx - bt_head/2, -A/2, 0))

pts.append(rg.Point3d(-L/2, -A/2, 0))

for feat in reversed(features_y):
    cy = feat['y']
    if feat['type'] == 'corbata':
        pts.append(rg.Point3d(-L/2, cy - bt_head/2, 0))
        pts.append(rg.Point3d(-L/2 + bt_depth/2, cy - bt_neck/2, 0))
        pts.append(rg.Point3d(-L/2 + bt_depth, cy - bt_head/2, 0))
        pts.append(rg.Point3d(-L/2 + bt_depth, cy + bt_head/2, 0))
        pts.append(rg.Point3d(-L/2 + bt_depth/2, cy + bt_neck/2, 0))
        pts.append(rg.Point3d(-L/2, cy + bt_head/2, 0))
    elif feat['type'] == 'encaje':
        pts.append(rg.Point3d(-L/2, cy - largo_corte/2, 0))
        pts.append(rg.Point3d(-L/2 + T, cy - largo_corte/2, 0))
        pts.append(rg.Point3d(-L/2 + T, cy + largo_corte/2, 0))
        pts.append(rg.Point3d(-L/2, cy + largo_corte/2, 0))

pts.append(pts[0])
contorno = rg.Polyline(pts).ToNurbsCurve()

# ---------------------------------------------------------
# 2. CONSTRUCCIÓN DE LAS RANURAS
# ---------------------------------------------------------
ancho_ranura = T + C
alto_ranura = A * 0.15 
separacion_y = A / 3.5 

def crear_ranura_segura(cx, cy, w, h):
    puntos_ranura = []
    puntos_ranura.append(rg.Point3d(cx - w/2, cy - h/2, 0))
    puntos_ranura.append(rg.Point3d(cx + w/2, cy - h/2, 0))
    puntos_ranura.append(rg.Point3d(cx + w/2, cy + h/2, 0))
    puntos_ranura.append(rg.Point3d(cx - w/2, cy + h/2, 0))
    puntos_ranura.append(puntos_ranura[0]) 
    return rg.Polyline(puntos_ranura).ToNurbsCurve()

ranuras = []
ranuras.append(crear_ranura_segura(0, 0, ancho_ranura, alto_ranura))
ranuras.append(crear_ranura_segura(0, separacion_y, ancho_ranura, alto_ranura))
ranuras.append(crear_ranura_segura(0, -separacion_y, ancho_ranura, alto_ranura))

# ---------------------------------------------------------
# 3. CONVERTIR TODO EN UNA SOLA SUPERFICIE SÓLIDA
# ---------------------------------------------------------
todas_las_curvas = [contorno]
todas_las_curvas.extend(ranuras)

# Esto crea un panel sólido con los 3 agujeros ya recortados en él
superficie_solida = rg.Brep.CreatePlanarBreps(todas_las_curvas, 0.01)

if superficie_solida:
    Geo = superficie_solida[0] # Entregamos 1 solo objeto a Grasshopper
else:
    Geo = todas_las_curvas # Modo a prueba de fallos
# ---------- end py3_2 ----------
py3_3 = Python3Script(
    L2=number_slider,
    A=number_slider_4,
    T=number_slider_3,
    C=number_slider_2,
    Ancho_Sacado=Slider(7, range=0..10),
    Prof_Sacado=number_slider_3)  # -> out, Geo; inputs L2: Double, A: Double, T: Double, C: Double
# ---------- py3_3: Python ----------
import Rhino.Geometry as rg

# ESCUDO ANTI-ERRORES
try: L2 = L2
except NameError: L2 = 80.0

try: A = A
except NameError: A = 100.0

try: T = T
except NameError: T = 3.0

try: C = C
except NameError: C = 0.1

try: Prof_Sacado = Prof_Sacado
except NameError: Prof_Sacado = 8.0

try: Ancho_Sacado = Ancho_Sacado
except NameError: Ancho_Sacado = 15.0

# ---------------------------------------------------------
# VARIABLES SECUNDARIAS
# ---------------------------------------------------------
notch_w = abs(Ancho_Sacado)   # Ancho exacto del sacado
notch_d = abs(Prof_Sacado)    # Profundidad hacia adentro

# Espigas/Dientes laterales (Se mantienen intactos para el calce)
h_tab = (A * 0.15) - C   
separacion_y = A / 3.5   
profundidad = T          

# ---------------------------------------------------------
# CONSTRUCCIÓN DEL PERÍMETRO
# ---------------------------------------------------------
pts = []

# A. Esquina Superior Izquierda
pts.append(rg.Point3d(-L2/2, A/2, 0))

# B. Borde Superior (UN SOLO SACADO CENTRADO)
pts.append(rg.Point3d(-notch_w/2, A/2, 0))               
pts.append(rg.Point3d(-notch_w/2, A/2 - notch_d, 0))     
pts.append(rg.Point3d(notch_w/2, A/2 - notch_d, 0))     
pts.append(rg.Point3d(notch_w/2, A/2, 0))               

# C. Esquina Superior Derecha
pts.append(rg.Point3d(L2/2, A/2, 0))

# D. BORDE DERECHO (3 Espigas hacia afuera)
pts.append(rg.Point3d(L2/2, separacion_y + h_tab/2, 0))
pts.append(rg.Point3d(L2/2 + profundidad, separacion_y + h_tab/2, 0)) 
pts.append(rg.Point3d(L2/2 + profundidad, separacion_y - h_tab/2, 0)) 
pts.append(rg.Point3d(L2/2, separacion_y - h_tab/2, 0))               

pts.append(rg.Point3d(L2/2, h_tab/2, 0))
pts.append(rg.Point3d(L2/2 + profundidad, h_tab/2, 0))                
pts.append(rg.Point3d(L2/2 + profundidad, -h_tab/2, 0))               
pts.append(rg.Point3d(L2/2, -h_tab/2, 0))                             

pts.append(rg.Point3d(L2/2, -separacion_y + h_tab/2, 0))
pts.append(rg.Point3d(L2/2 + profundidad, -separacion_y + h_tab/2, 0)) 
pts.append(rg.Point3d(L2/2 + profundidad, -separacion_y - h_tab/2, 0)) 
pts.append(rg.Point3d(L2/2, -separacion_y - h_tab/2, 0))               

# E. Esquina Inferior Derecha
pts.append(rg.Point3d(L2/2, -A/2, 0))

# F. Borde Inferior (UN SOLO SACADO CENTRADO)
pts.append(rg.Point3d(notch_w/2, -A/2, 0))              
pts.append(rg.Point3d(notch_w/2, -A/2 + notch_d, 0))    
pts.append(rg.Point3d(-notch_w/2, -A/2 + notch_d, 0))    
pts.append(rg.Point3d(-notch_w/2, -A/2, 0))              

# G. Esquina Inferior Izquierda
pts.append(rg.Point3d(-L2/2, -A/2, 0))

# H. BORDE IZQUIERDO (3 Espigas hacia afuera)
pts.append(rg.Point3d(-L2/2, -separacion_y - h_tab/2, 0))
pts.append(rg.Point3d(-L2/2 - profundidad, -separacion_y - h_tab/2, 0)) 
pts.append(rg.Point3d(-L2/2 - profundidad, -separacion_y + h_tab/2, 0)) 
pts.append(rg.Point3d(-L2/2, -separacion_y + h_tab/2, 0))               

pts.append(rg.Point3d(-L2/2, -h_tab/2, 0))
pts.append(rg.Point3d(-L2/2 - profundidad, -h_tab/2, 0))                
pts.append(rg.Point3d(-L2/2 - profundidad, h_tab/2, 0))                 
pts.append(rg.Point3d(-L2/2, h_tab/2, 0))                               

pts.append(rg.Point3d(-L2/2, separacion_y - h_tab/2, 0))
pts.append(rg.Point3d(-L2/2 - profundidad, separacion_y - h_tab/2, 0))  
pts.append(rg.Point3d(-L2/2 - profundidad, separacion_y + h_tab/2, 0))  
pts.append(rg.Point3d(-L2/2, separacion_y + h_tab/2, 0))                

# Cerramos la figura
pts.append(pts[0])

contorno = rg.Polyline(pts).ToNurbsCurve()

# ---------------------------------------------------------
# EXPORTAR COMO SUPERFICIE SÓLIDA (Para OpenNest)
# ---------------------------------------------------------
superficie_solida = rg.Brep.CreatePlanarBreps([contorno], 0.01)

if superficie_solida:
    Geo = superficie_solida[0]
else:
    Geo = contorno
# ---------- end py3_3 ----------
panel_6 = Panel("BASE")
panel_7 = Panel("INTERIOR 3 RANURAS")
py3_4 = Python3Script(
    L2=number_slider,
    A=number_slider_4,
    T=number_slider_3,
    C=number_slider_2,
    Ancho_Sacado=Slider(7, range=0..10),
    Prof_Sacado=number_slider_3)  # -> out, Geo; inputs L2: Double, A: Double, T: Double, C: Double
# ---------- py3_4: Python ----------
import Rhino.Geometry as rg

# ESCUDO ANTI-ERRORES
try: L2 = L2
except NameError: L2 = 80.0

try: A = A
except NameError: A = 100.0

try: T = T
except NameError: T = 3.0

try: C = C
except NameError: C = 0.1

try: Prof_Sacado = Prof_Sacado
except NameError: Prof_Sacado = 8.0

try: Ancho_Sacado = Ancho_Sacado
except NameError: Ancho_Sacado = 15.0

# ---------------------------------------------------------
# VARIABLES SECUNDARIAS
# ---------------------------------------------------------
notch_w = abs(Ancho_Sacado)   # Ancho del sacado superior e inferior
notch_d = abs(Prof_Sacado)    # Profundidad del sacado

# Dimensiones de la espiga central (hacia afuera)
h_tab = (A * 0.15) - C        # Alto del diente (basado en la proporción)
profundidad = T               # Lo que sobresale (espesor del material)

# ---------------------------------------------------------
# CONSTRUCCIÓN DEL PERÍMETRO
# ---------------------------------------------------------
pts = []

# A. Esquina Superior Izquierda
pts.append(rg.Point3d(-L2/2, A/2, 0))

# B. Borde Superior (Sacado rectangular centrado)
pts.append(rg.Point3d(-notch_w/2, A/2, 0))               
pts.append(rg.Point3d(-notch_w/2, A/2 - notch_d, 0))     
pts.append(rg.Point3d(notch_w/2, A/2 - notch_d, 0))     
pts.append(rg.Point3d(notch_w/2, A/2, 0))               

# C. Esquina Superior Derecha
pts.append(rg.Point3d(L2/2, A/2, 0))

# D. BORDE DERECHO (UNA SOLA ESPIGA HACIA AFUERA AL CENTRO)
pts.append(rg.Point3d(L2/2, h_tab/2, 0))
pts.append(rg.Point3d(L2/2 + profundidad, h_tab/2, 0))                # Sale
pts.append(rg.Point3d(L2/2 + profundidad, -h_tab/2, 0))               # Baja
pts.append(rg.Point3d(L2/2, -h_tab/2, 0))                             # Entra

# E. Esquina Inferior Derecha
pts.append(rg.Point3d(L2/2, -A/2, 0))

# F. Borde Inferior (Sacado rectangular centrado)
pts.append(rg.Point3d(notch_w/2, -A/2, 0))              
pts.append(rg.Point3d(notch_w/2, -A/2 + notch_d, 0))    
pts.append(rg.Point3d(-notch_w/2, -A/2 + notch_d, 0))    
pts.append(rg.Point3d(-notch_w/2, -A/2, 0))              

# G. Esquina Inferior Izquierda
pts.append(rg.Point3d(-L2/2, -A/2, 0))

# H. BORDE IZQUIERDO (UNA SOLA ESPIGA HACIA AFUERA AL CENTRO)
pts.append(rg.Point3d(-L2/2, -h_tab/2, 0))
pts.append(rg.Point3d(-L2/2 - profundidad, -h_tab/2, 0))                # Sale (izq)
pts.append(rg.Point3d(-L2/2 - profundidad, h_tab/2, 0))                 # Sube
pts.append(rg.Point3d(-L2/2, h_tab/2, 0))                               # Entra

# Cerramos la figura
pts.append(pts[0])

contorno = rg.Polyline(pts).ToNurbsCurve()

# ---------------------------------------------------------
# EXPORTAR COMO SUPERFICIE SÓLIDA (Para OpenNest)
# ---------------------------------------------------------
superficie_solida = rg.Brep.CreatePlanarBreps([contorno], 0.01)

if superficie_solida:
    Geo = superficie_solida[0]
else:
    Geo = contorno
# ---------- end py3_4 ----------
panel_8 = Panel("EXTERIOR 1 RANURA")
X_3 = UnitX(Factor=Slider(506, range=0..1000))
n_piezas_2 = Slider(1, range=0..50)
n_piezas_3 = Slider(1, range=0..50)
move = Move(Geometry=py3.Geo, Motion=X_3)  # -> Geometry, Transform
X_4 = UnitX(Factor=Slider(306, range=0..1000))
dup = DuplicateData(Data=py3_3.Geo, Number=n_piezas_3, Order=True)
n_piezas_4 = Slider(1, range=0..50)
vec = VectorXYZ(XComponent=Slider(-2, range=-500..500), YComponent=Slider(0, range=-500..500), ZComponent=Slider(236, range=-500..500))  # -> Vector, Length
srf = Surface(py3_2.Geo)
vec_2 = VectorXYZ(XComponent=Slider(-75, range=-500..500), YComponent=Slider(-1, range=-500..500), ZComponent=Slider(236, range=-500..500))  # -> Vector, Length
dup_2 = DuplicateData(Data=py3_4.Geo, Number=n_piezas, Order=True)
vec_3 = VectorXYZ(XComponent=Slider(0, range=-500..500), YComponent=Slider(-48, range=-500..500), ZComponent=Slider(236, range=-500..500))  # -> Vector, Length
vec_4 = VectorXYZ(XComponent=Slider(-1, range=-500..500), YComponent=Slider(-1, range=-500..500), ZComponent=Slider(221, range=-500..500))  # -> Vector, Length
dup_3 = DuplicateData(Data=py3.Geo, Number=n_piezas_4, Order=True)
dup_4 = DuplicateData(Data=py3_2.Geo, Number=n_piezas_2, Order=True)
vec_5 = VectorXYZ(XComponent=Slider(-1, range=-500..500), YComponent=Slider(-1, range=-500..500), ZComponent=Slider(248, range=-500..500))  # -> Vector, Length
vec_6 = VectorXYZ(XComponent=Slider(0, range=-500..500), YComponent=Slider(50, range=-500..500), ZComponent=Slider(236, range=-500..500))  # -> Vector, Length
vec_7 = VectorXYZ(XComponent=Slider(72, range=-500..500), YComponent=Slider(-1, range=-500..500), ZComponent=Slider(236, range=-500..500))  # -> Vector, Length
move_2 = Move(Geometry=py3_2.Geo, Motion=X_4)  # -> Geometry, Transform
merge = Merge(Data1=dup, Data2=dup_3, Data3=dup_2)  # -> flatten(Result)
merge_2 = Merge(Data1=merge, Data2=dup_4)  # -> flatten(Result)
extr = Extrude(Base=merge_2, Direction=Z)
item = ListItem(List=extr, Index=0, Wrap=True)  # -> Item, Item1, Item2, Item3
rot3d = Rotate3D(Geometry=item.Item1, Angle=degrees(Slider(89, range=0..100)), Center=Point(0, 0, 0), Axis=X)  # -> Geometry, Transform
rot3d_2 = Rotate3D(Geometry=item.Item2, Angle=degrees(Slider(90, range=0..100)), Center=Point(0, 0, 0), Axis=Y_2)  # -> Geometry, Transform
rot3d_3 = Rotate3D(Geometry=item.Item, Angle=degrees(Slider(90, range=0..100)), Center=Point(0, 0, 0), Axis=Y)  # -> Geometry, Transform
rot3d_4 = Rotate3D(Geometry=item.Item3, Angle=degrees(Slider(0, range=0..100)), Center=Point(0, 0, 0), Axis=X_2)  # -> Geometry, Transform
move_3 = Move(Geometry=rot3d_2.Geometry, Motion=vec_2.Vector)  # -> Geometry, Transform
move_4 = Move(Geometry=rot3d_2.Geometry, Motion=vec_2.Vector)  # -> Geometry, Transform
move_5 = Move(Geometry=rot3d_3.Geometry, Motion=vec.Vector)  # -> Geometry, Transform
move_6 = Move(Geometry=rot3d.Geometry, Motion=vec_3.Vector)  # -> Geometry, Transform
move_7 = Move(Geometry=rot3d.Geometry, Motion=vec_3.Vector)  # -> Geometry, Transform
move_8 = Move(Geometry=rot3d_3.Geometry, Motion=vec.Vector)  # -> Geometry, Transform
move_9 = Move(Geometry=rot3d_4.Geometry, Motion=vec_4.Vector)  # -> Geometry, Transform
move_10 = Move(Geometry=rot3d_4.Geometry, Motion=vec_4.Vector)  # -> Geometry, Transform
move_11 = Move(Geometry=rot3d_4.Geometry, Motion=vec_5.Vector)  # -> Geometry, Transform
move_12 = Move(Geometry=rot3d_4.Geometry, Motion=vec_5.Vector)  # -> Geometry, Transform
move_13 = Move(Geometry=rot3d.Geometry, Motion=vec_6.Vector)  # -> Geometry, Transform
move_14 = Move(Geometry=rot3d.Geometry, Motion=vec_6.Vector)  # -> Geometry, Transform
move_15 = Move(Geometry=rot3d_2.Geometry, Motion=vec_7.Vector)  # -> Geometry, Transform
move_16 = Move(Geometry=rot3d_2.Geometry, Motion=vec_7.Vector)  # -> Geometry, Transform
number_slider_5 = Slider(400, range=0..10000)
number_slider_6 = Slider(300, range=0..10000)
diámetro_de_fresa_cnc_mm = Slider(3, range=2..20)
boundary = BoundarySurfaces(Edges=merge)
rectangle = Rectangle(Plane=PlaneXY(0, 0, 0), XSize=number_slider_5, YSize=number_slider_6, Radius=0)  # -> Rectangle, Length
boundary_2 = BoundarySurfaces(Edges=rectangle.Rectangle)
opennest1 = OpenNest1(
    Sheets=boundary_2,
    Geo=[dup_4, boundary],
    Spacing=diámetro_de_fresa_cnc_mm,
    Placement=1,
    Tolerance=0.1,
    Rotations=4,
    Iterations=6,
    Seed=1,
    Reset=False,
    Run=Toggle(True))  # -> Sheets, Geo, ID, Transform, IDS
edges = BrepEdges(Brep=opennest1.Geo)  # -> Naked, Interior, NonManifold
flatten = FlattenTree(Tree=edges.Naked, Path="{0}")
py3_5 = Python3Script(Curvas=flatten, Ruta="C:/Users/janth/OneDrive/Escritorio/PIEZAS.dxf", Exportar=Button())  # -> out, a; inputs Curvas: list of GeometryBase
# ---------- py3_5: Python ----------
import os
import rhinoscriptsyntax as rs
import scriptcontext as sc
import Rhino

if "Exportar" in locals() and Exportar == True:
    if "Curvas" not in locals() or not Curvas:
        print("Error: Falta conectar el cable de las Curvas.")
    elif "Ruta" not in locals() or not Ruta:
        print("Error: Falta conectar el cable de la Ruta.")
    else:
        # 1. Limpiar el texto del panel por si hay espacios invisibles
        texto_ruta = str(Ruta).replace('\n', '').replace('\r', '').strip().replace('\\', '/')
        if not texto_ruta.lower().endswith('.dxf'):
            texto_ruta += '.dxf'

        # 2. SEPARAMOS LA CARPETA DEL NOMBRE DEL ARCHIVO
        carpeta = os.path.dirname(texto_ruta)
        nombre_archivo = os.path.basename(texto_ruta)

        # Verificar que la carpeta del panel realmente exista en tu PC
        if not os.path.exists(carpeta):
            print(f"Error: La carpeta no existe. Revisa que esté bien escrita:\n{carpeta}")
        else:
            sc.doc = Rhino.RhinoDoc.ActiveDoc
            rs.UnselectAllObjects()

            geometrias = Curvas if isinstance(Curvas, list) else [Curvas]
            ids_creados = []

            for geo in geometrias:
                if geo:
                    obj_id = sc.doc.Objects.Add(geo)
                    if obj_id:
                        ids_creados.append(obj_id)

            if ids_creados:
                rs.SelectObjects(ids_creados)
                sc.doc.Views.Redraw()

                # Borrar versión anterior para evitar que Rhino pregunte si deseas sobreescribir
                if os.path.exists(texto_ruta):
                    try:
                        os.remove(texto_ruta)
                    except Exception:
                        pass

                # 3. EL TRUCO: Cambiamos el directorio de trabajo de Rhino a tu escritorio
                rs.WorkingFolder(carpeta)

                # 4. Le damos la orden usando SOLO el nombre corto (igual que cuando funcionó con "true")
                cmd = f'! _-Export "{nombre_archivo}" _Enter _Enter'
                rs.Command(cmd, False)

                # Limpieza de la pantalla
                for i in ids_creados:
                    sc.doc.Objects.Delete(i, True)
                
                rs.UnselectAllObjects()
                sc.doc.Views.Redraw()

                # 5. Comprobación final
                if os.path.exists(texto_ruta):
                    print(f"¡AHORA SÍ!\nTu archivo está guardado en:\n{texto_ruta}")
                else:
                    print("Error: Rhino canceló. Presiona la tecla ESC 3 veces en Rhino y reintenta.")
            else:
                print("Error: Las curvas conectadas no son válidas.")
else:
    print("En reposo. Pulsa el botón para exportar.")
# ---------- end py3_5 ----------
panel_9 = Panel(py3_5.out)
lng = ListLength(List=opennest1.Sheets)
len = Length(Curve=opennest1.Geo)
velocidad_de_corte_mm_min = Slider(150, range=0..10000)
ma = MassAddition(Input=flatten(len))  # -> Result, PartialResults
# PERIMETRO DE PIEZAS TOTALES
panel_10 = Panel(ma.Result)
join = JoinCurves(Curves=flatten, Preserve=False)
division = Division(A=ma.Result, B=velocidad_de_corte_mm_min)
area = Area(Geometry=join)  # -> Area, Centroid
multiplication = Multiplication(A=number_slider_5, B=number_slider_6)
panel_11 = Panel("TIEMPO DE CORTE")
panel_12 = Panel(division)
ma_2 = MassAddition(Input=flatten(area.Area))  # -> Result, PartialResults
densidad_del_material_kg_m3 = Slider(700, range=0..1000)
division_2 = Division(A=multiplication, B="1000000")
division_3 = Division(A=number_slider_3, B="1000")
costo_por_minuto = Slider(3000, range=0..10000)
division_4 = Division(A=ma_2.Result, B="1000000")
division_5 = Division(A="35000", B=division_2)
multiplication_2 = Multiplication(A=lng, B=division_2)
multiplication_3 = Multiplication(A=division_3, B=division_4)
# PRECIO POR M2 DE PLANCHA
panel_13 = Panel(division_5)
division_6 = Division(A=division_4, B=multiplication_2)
# M2 NETOS DE LAS PIEZAS
panel_14 = Panel(division_4)
multiplication_4 = Multiplication(A=multiplication_3, B=densidad_del_material_kg_m3)
multiplication_5 = Multiplication(A=panel_12, B=costo_por_minuto)
multiplication_6 = Multiplication(A=division_6, B="100")
panel_15 = Panel(multiplication_4)
panel_16 = Panel("PESO (KG)")
multiplication_7 = Multiplication(A=panel_13, B=panel_14)
panel_17 = Panel(multiplication_6)
panel_18 = Panel("EFICIENCIA PLANCHA")
panel_19 = Panel(multiplication_5)
panel_20 = Panel("PRECIO DE PIEZAS")
panel_21 = Panel(multiplication_7)
subtraction = Subtraction(A="35000", B=multiplication_7)
py3_6 = Python3Script(
    Exportar=Button(),
    Ruta="C:/Users/janth/OneDrive/Escritorio/PIEZAS.dxf",
    Planchas=lng,
    CostoMerma=subtraction,
    Eficiencia=multiplication_6,
    Espesor=Slider(3, range=1..30))  # -> out, a; inputs Exportar: list of Boolean, Ruta: String
# ---------- py3_6: Python ----------
import os
import csv
from datetime import datetime

if "Exportar" in locals() and Exportar:
    if not Ruta:
        print("Error: Falta conectar la ruta.")
    else:
        ruta_str = str(Ruta).strip().strip('"').replace('\\', '/')
        ruta_csv = ruta_str.rsplit('.', 1)[0] + "_DATOS.csv"
        
        file_exists = os.path.isfile(ruta_csv)
        
        try:
            with open(ruta_csv, mode='a', newline='') as file:
                writer = csv.writer(file, delimiter=';') 
                
                # TÍTULOS: Se agrega la columna de Huella de Carbono
                if not file_exists:
                    writer.writerow(['Fecha y Hora', 'Planchas Usadas', 'Costo Compra (CLP)', 'Costo Merma (CLP)', 'Eficiencia (%)', 'CO2 Emitido por Merma (kg)'])
                
                fecha = datetime.now().strftime("%Y-%m-%d %H:%M")
                
                v_planchas = float(Planchas[0]) if isinstance(Planchas, list) else float(Planchas)
                v_compra = float(CostoCompra[0]) if isinstance(CostoCompra, list) else float(CostoCompra)
                v_merma = float(CostoMerma[0]) if isinstance(CostoMerma, list) else float(CostoMerma)
                v_eficiencia = float(Eficiencia[0]) if isinstance(Eficiencia, list) else float(Eficiencia)
                
                # --- MOTOR DE CÁLCULO AMBIENTAL ---
                v_co2 = 0.0
                if "AreaPlancha" in locals() and AreaPlancha and "Espesor" in locals() and Espesor:
                    v_area_plancha = float(AreaPlancha[0]) if isinstance(AreaPlancha, list) else float(AreaPlancha)
                    v_espesor = float(Espesor[0]) if isinstance(Espesor, list) else float(Espesor)
                    
                    # 1. Área total usada en m2 (el panel viene en mm2, lo dividimos por 1 millón)
                    area_total_m2 = (v_area_plancha / 1000000) * v_planchas
                    
                    # 2. Área de merma en m2 (el porcentaje ineficiente)
                    area_merma_m2 = area_total_m2 * (1 - (v_eficiencia / 100))
                    
                    # 3. Volumen de merma en m3 (el espesor viene en mm, lo dividimos por mil)
                    volumen_merma_m3 = area_merma_m2 * (v_espesor / 1000)
                    
                    # 4. Masa y Factor de Emisión (600 kg/m3 de densidad * 1.6 factor CO2)
                    masa_kg = volumen_merma_m3 * 600
                    v_co2 = masa_kg * 1.6
                
                # Ajuste de formatos (puntos por comas para el Excel chileno)
                str_planchas = str(round(v_planchas, 2)).replace('.', ',')
                str_compra = str(round(v_compra, 0)).replace('.', ',')
                str_merma = str(round(v_merma, 0)).replace('.', ',')
                str_eficiencia = str(round(v_eficiencia, 2)).replace('.', ',')
                str_co2 = str(round(v_co2, 2)).replace('.', ',')
                
                # Escribimos la fila completa con el dato ambiental
                writer.writerow([
                    fecha, 
                    str_planchas,
                    str_compra, 
                    str_merma, 
                    str_eficiencia,
                    str_co2
                ])
                
            print(f"¡CÁLCULO AMBIENTAL INTEGRADO!\nDatos guardados en:\n{ruta_csv}")
        except Exception as e:
            print(f"Error detallado: {e}")
else:
    print("En reposo. Pulsa el botón para registrar los datos.")
# ---------- end py3_6 ----------
panel_22 = Panel(py3_6.out)
panel_23 = Panel(subtraction)
panel_24 = Panel("COSTO MERMA")
