# Grasshopper definition PRUEBA 4 - copia.gh (Grasshopper 1.0.8)
# plug-ins: opennest_2 Info

number_slider = Slider(5.5, range=0..10)
number_slider_2 = Slider(6, range=0..10)
number_slider_3 = Slider(5, range=0..10)
number_slider_4 = Slider(7.55, range=0..10)
number_slider_5 = Slider(20, range=0..100)

# ---- group: CORBATA
number_slider_6 = Slider(9, range=0..10)
number_slider_7 = Slider(11, range=0..100)
n_piezas = Slider(3, range=0..50)
py3 = Python3Script(
    T=number_slider_2,
    H=number_slider_7,
    W_top=number_slider_6,
    W_mid=number_slider,
    R=Slider(0, range=0..1),
    C=Slider(0.5, range=0..1))  # -> out, Piece_Curve; inputs T: Double, H: Double, W_top: Double, W_mid: Double, R: Double, C: Double
# ---------- py3: Python ----------
import Rhino.Geometry as rg

# 1. Aplicar holgura (C) reduciendo las cotas nominales
h_adj = H - C
w_top_adj = W_top - C
w_mid_adj = W_mid - C

# 2. Calcular las coordenadas a partir del centro (0,0)
y_top = h_adj / 2.0
x_top = w_top_adj / 2.0
x_mid = w_mid_adj / 2.0

# 3. Definir los 6 vértices del perímetro (sentido horario)
pts = []
pts.append(rg.Point3d(x_top, y_top, 0))     # 1. Arriba derecha
pts.append(rg.Point3d(x_mid, 0, 0))         # 2. Cintura derecha
pts.append(rg.Point3d(x_top, -y_top, 0))    # 3. Abajo derecha
pts.append(rg.Point3d(-x_top, -y_top, 0))   # 4. Abajo izquierda
pts.append(rg.Point3d(-x_mid, 0, 0))        # 5. Cintura izquierda
pts.append(rg.Point3d(-x_top, y_top, 0))    # 6. Arriba izquierda
pts.append(pts[0])                          # 7. Cerrar polilínea

# 4. Crear la curva base (líneas rectas)
poly = rg.Polyline(pts).ToNurbsCurve()

# 5. Aplicar radio de empalme (Fillet) a las esquinas
# Si R es mayor a 0, redondeamos. Si R = 0, dejamos rectas.
if R > 0.0:
    # Tolerancias de Rhino para el cálculo del Fillet (0.01 unidades, 0.1 radianes)
    filleted_curve = rg.Curve.CreateFilletCornersCurve(poly, R, 0.01, 0.1)
    
    # Verificamos que el radio no sea tan grande que rompa la geometría
    if filleted_curve:
        Piece_Curve = filleted_curve
    else:
        # Si el radio ingresado destruye la pieza, devolvemos la versión recta por seguridad
        Piece_Curve = poly 
else:
    Piece_Curve = poly
# ---------- end py3 ----------
dup = DuplicateData(Data=py3.Piece_Curve, Number=n_piezas, Order=True)

# ---- group: CARA PRINCIPAL
number_slider_8 = Slider(240, range=0..1000)
number_slider_9 = Slider(10, range=0..10)
number_slider_10 = Slider(3.8853, range=0..10)
py3_2 = Python3Script(
    H_total=number_slider_8,
    W_total=Slider(54, range=0..100),
    T=number_slider_2,
    L_slot=number_slider_5,
    S_slot=number_slider_4,
    Corbata_H=number_slider_7,
    Corbata_W_top=number_slider_6,
    Corbata_W_mid=number_slider,
    Hole_W=Slider(12, range=0..100),
    Hole_H=number_slider_2,
    Mod_gap=number_slider_10,
    Corner_gap=number_slider_9)  # -> out, Piece_Curves; inputs H_total: Double, W_total: Double, T: Double, L_slot: Double, S_slot: Double, Corbata_H: Double, Corbata_W_top: Double, Corbata_W_mid: Double, Hole_W: Double, Hole_H: Double, Mod_gap: Double
# ---------- py3_2: Python ----------
import Rhino.Geometry as rg

# 1. Variables de las Corbatas controladas por tus sliders maestros
c_open = Corbata_W_mid
c_base = Corbata_W_top
c_depth = Corbata_H / 2.0
c_flare = (c_base - c_open) / 2.0

# 2. Distribución paramétrica de EXTREMOS
rem_w = W_total - (3 * c_open)
ratio_s = 4.7 / (4.7 * 2 + 13.92 * 2) 
end_s_gap = rem_w * ratio_s
end_l_gap = (rem_w - (2 * end_s_gap)) / 2.0

w_e = W_total / 2.0
w_body = w_e + T 

# 3. Distribución paramétrica de COSTADOS
fixed_side_len = (8 * c_open) + (4 * S_slot) + (3 * L_slot) + (8 * Mod_gap)
side_in_gap = (H_total - fixed_side_len - (2 * Corner_gap)) / 8.0 

y_t = H_total / 2.0
pts = []

# 4. SECUENCIA DEL PATRÓN
module_seq = [('D', c_open), ('G', Mod_gap), ('S', S_slot), ('G', Mod_gap), ('D', c_open)]

side_seq = [('G', side_in_gap)] + module_seq + [
    ('G', side_in_gap), ('L', L_slot), ('G', side_in_gap)
] + module_seq + [
    ('G', side_in_gap), ('L', L_slot), ('G', side_in_gap)
] + module_seq + [
    ('G', side_in_gap), ('L', L_slot), ('G', side_in_gap)
] + module_seq + [('G', side_in_gap)]

top_seq = [
    ('G', end_s_gap), ('D', c_open), ('G', end_l_gap), ('D', c_open),
    ('G', end_l_gap), ('D', c_open), ('G', end_s_gap)
]

# --- TRAZADO DEL PERÍMETRO ---
x = w_e
y = -y_t
pts.append(rg.Point3d(x, y, 0))

y += Corner_gap
pts.append(rg.Point3d(x, y, 0)) 
x = w_body
pts.append(rg.Point3d(x, y, 0)) 

for item, length in side_seq:
    if item == 'G':
        y += length
        pts.append(rg.Point3d(x, y, 0))
    elif item == 'D':
        pts.append(rg.Point3d(x - c_depth, y - c_flare, 0))
        pts.append(rg.Point3d(x - c_depth, y + length + c_flare, 0))
        y += length
        pts.append(rg.Point3d(x, y, 0))
    elif item in ['S', 'L']:
        pts.append(rg.Point3d(x - T, y, 0))
        pts.append(rg.Point3d(x - T, y + length, 0))
        y += length
        pts.append(rg.Point3d(x, y, 0))

x = w_e
pts.append(rg.Point3d(x, y, 0)) 
y += Corner_gap 
pts.append(rg.Point3d(x, y, 0)) 

for item, length in top_seq:
    if item == 'G':
        x -= length
        pts.append(rg.Point3d(x, y, 0))
    elif item == 'D':
        pts.append(rg.Point3d(x + c_flare, y - c_depth, 0))
        pts.append(rg.Point3d(x - length - c_flare, y - c_depth, 0))
        x -= length
        pts.append(rg.Point3d(x, y, 0))

y -= Corner_gap
pts.append(rg.Point3d(x, y, 0)) 
x = -w_body
pts.append(rg.Point3d(x, y, 0)) 

for item, length in reversed(side_seq):
    if item == 'G':
        y -= length
        pts.append(rg.Point3d(x, y, 0))
    elif item == 'D':
        pts.append(rg.Point3d(x + c_depth, y + c_flare, 0))
        pts.append(rg.Point3d(x + c_depth, y - length - c_flare, 0))
        y -= length
        pts.append(rg.Point3d(x, y, 0))
    elif item in ['S', 'L']:
        pts.append(rg.Point3d(x + T, y, 0))
        pts.append(rg.Point3d(x + T, y - length, 0))
        y -= length
        pts.append(rg.Point3d(x, y, 0))

x = -w_e
pts.append(rg.Point3d(x, y, 0)) 
y -= Corner_gap
pts.append(rg.Point3d(x, y, 0)) 

for item, length in reversed(top_seq):
    if item == 'G':
        x += length
        pts.append(rg.Point3d(x, y, 0))
    elif item == 'D':
        pts.append(rg.Point3d(x - c_flare, y + c_depth, 0))
        pts.append(rg.Point3d(x + length + c_flare, y + c_depth, 0))
        x += length
        pts.append(rg.Point3d(x, y, 0))

outline = rg.Polyline(pts).ToNurbsCurve()

# --- SACADOS CENTRALES ---
holes = []
dist_to_L = side_in_gap + c_open + Mod_gap + S_slot + Mod_gap + c_open + side_in_gap + (L_slot / 2.0)
y_L1 = -y_t + Corner_gap + dist_to_L
hole_centers_y = [y_L1, 0.0, -y_L1]

for cy in hole_centers_y:
    h_pts = [
        rg.Point3d(-Hole_W/2.0, cy - Hole_H/2.0, 0),
        rg.Point3d(Hole_W/2.0, cy - Hole_H/2.0, 0),
        rg.Point3d(Hole_W/2.0, cy + Hole_H/2.0, 0),
        rg.Point3d(-Hole_W/2.0, cy + Hole_H/2.0, 0),
        rg.Point3d(-Hole_W/2.0, cy - Hole_H/2.0, 0)
    ]
    holes.append(rg.Polyline(h_pts).ToNurbsCurve())

Piece_Curves = [outline] + holes
# ---------- end py3_2 ----------
n_piezas_2 = Slider(2, range=0..100)
boundary = BoundarySurfaces(Edges=py3_2.Piece_Curves)  # -> flatten(Surfaces)
dup_2 = DuplicateData(Data=boundary, Number=n_piezas_2, Order=True)

# ---- group: HORIZONTAL
py3_3 = Python3Script(
    H_core=Slider(234, range=0..1000),
    W_core=Slider(17.8, range=0..100),
    W_ext=Slider(24, range=0..100),
    T=number_slider_2,
    L_tab=number_slider_5,
    S_tab=number_slider_4,
    Spacing=Slider(16.3, range=0..100),
    Ext_mid=number_slider,
    Ext_side=Slider(4.275, range=0..10),
    Hole_w=number_slider_3,
    Hole_h=number_slider_2,
    Ext_h=Slider(5.895, range=0..10),
    y_slot_bot=number_slider_2,
    H_total=number_slider_8,
    Corner_gap=number_slider_9,
    Mod_gap=number_slider_10,
    Corbata_W_mid=number_slider)  # -> out, Piece_Curves; inputs H_core: Double, W_core: Double, W_ext: Double, T: Double, L_tab: Double, S_tab: Double, Spacing: Double, Ext_mid: Double, Ext_side: Double, Hole_w: Double, Hole_h: Double
# ---------- py3_3: Python ----------
import Rhino.Geometry as rg

# ==========================================
# 1. CÁLCULO DE SINCRONIZACIÓN (El Cerebro DfMA)
# ==========================================
fixed_side_len = (8 * Corbata_W_mid) + (4 * S_tab) + (3 * L_tab) + (8 * Mod_gap)
side_in_gap = (H_total - fixed_side_len - (2 * Corner_gap)) / 8.0 
Spacing = Mod_gap + Corbata_W_mid + side_in_gap

# ==========================================
# 2. DIMENSIONES ABSOLUTAS (Ambas piezas a 240mm)
# ==========================================
y_ext = H_total / 2.0         # Límite superior e inferior absoluto (ej. 120 mm)
y_t = y_ext - Corner_gap      # Núcleo donde arrancan los costados (ej. 110 mm)
top_solid = Spacing           # Distancia exacta a la primera pestaña

# Variables Base
w_c = W_core / 2.0
w_e = W_ext / 2.0

y_bot_ext = -y_ext
y_bot_t = -y_t

y_slot_bot = y_ext - T 
y_bot_slot = y_bot_ext + T

slot_top_w = (W_ext - Ext_mid - (2 * Ext_side)) / 2.0

pts = []

# --- BORDE SUPERIOR ---
pts.append(rg.Point3d(w_c, y_t, 0))
pts.append(rg.Point3d(w_e, y_t, 0))
pts.append(rg.Point3d(w_e, y_ext, 0))
pts.append(rg.Point3d(w_e - Ext_side, y_ext, 0))
pts.append(rg.Point3d(w_e - Ext_side, y_slot_bot, 0)) 
pts.append(rg.Point3d(w_e - Ext_side - slot_top_w, y_slot_bot, 0))
pts.append(rg.Point3d(w_e - Ext_side - slot_top_w, y_ext, 0))
pts.append(rg.Point3d(-w_e + Ext_side + slot_top_w, y_ext, 0))
pts.append(rg.Point3d(-w_e + Ext_side + slot_top_w, y_slot_bot, 0))
pts.append(rg.Point3d(-w_e + Ext_side, y_slot_bot, 0))
pts.append(rg.Point3d(-w_e + Ext_side, y_ext, 0))
pts.append(rg.Point3d(-w_e, y_ext, 0))
pts.append(rg.Point3d(-w_e, y_t, 0))
pts.append(rg.Point3d(-w_c, y_t, 0))

# --- BORDE IZQUIERDO ---
segments = [
    (S_tab, True), (Spacing, False), (L_tab, True), (Spacing, False),
    (S_tab, True), (Spacing, False), (L_tab, True), (Spacing, False),
    (S_tab, True), (Spacing, False), (L_tab, True), (Spacing, False),
    (S_tab, True)
]

y_curr = y_t - top_solid
pts.append(rg.Point3d(-w_c, y_curr, 0))

for length, is_tab in segments:
    if is_tab:
        pts.append(rg.Point3d(-w_c - T, y_curr, 0)) 
        y_curr -= length
        pts.append(rg.Point3d(-w_c - T, y_curr, 0)) 
        pts.append(rg.Point3d(-w_c, y_curr, 0))     
    else:
        y_curr -= length
        pts.append(rg.Point3d(-w_c, y_curr, 0))     

pts.append(rg.Point3d(-w_c, -y_t, 0))

# --- BORDE INFERIOR ---
pts.append(rg.Point3d(-w_e, -y_t, 0))
pts.append(rg.Point3d(-w_e, y_bot_ext, 0))
pts.append(rg.Point3d(-w_e + Ext_side, y_bot_ext, 0))
pts.append(rg.Point3d(-w_e + Ext_side, y_bot_slot, 0)) 
pts.append(rg.Point3d(-w_e + Ext_side + slot_top_w, y_bot_slot, 0))
pts.append(rg.Point3d(-w_e + Ext_side + slot_top_w, y_bot_ext, 0))
pts.append(rg.Point3d(w_e - Ext_side - slot_top_w, y_bot_ext, 0))
pts.append(rg.Point3d(w_e - Ext_side - slot_top_w, y_bot_slot, 0))
pts.append(rg.Point3d(w_e - Ext_side, y_bot_slot, 0))
pts.append(rg.Point3d(w_e - Ext_side, y_bot_ext, 0))
pts.append(rg.Point3d(w_e, y_bot_ext, 0))
pts.append(rg.Point3d(w_e, -y_t, 0))
pts.append(rg.Point3d(w_c, -y_t, 0))

# --- BORDE DERECHO ---
y_curr = -y_t + top_solid
pts.append(rg.Point3d(w_c, y_curr, 0))

for length, is_tab in segments:
    if is_tab:
        pts.append(rg.Point3d(w_c + T, y_curr, 0)) 
        y_curr += length
        pts.append(rg.Point3d(w_c + T, y_curr, 0)) 
        pts.append(rg.Point3d(w_c, y_curr, 0))     
    else:
        y_curr += length
        pts.append(rg.Point3d(w_c, y_curr, 0))     

pts.append(rg.Point3d(w_c, y_t, 0))
outline = rg.Polyline(pts).ToNurbsCurve()

# --- SACADOS CENTRALES (Alineados a la matemática maestra) ---
holes = []
y_L1 = -y_t + top_solid + S_tab + Spacing + (L_tab / 2.0)
hole_centers_y = [y_L1, 0.0, -y_L1]

for cy in hole_centers_y:
    h_pts = [
        rg.Point3d(-Hole_w/2.0, cy - Hole_h/2.0, 0),
        rg.Point3d(Hole_w/2.0, cy - Hole_h/2.0, 0),
        rg.Point3d(Hole_w/2.0, cy + Hole_h/2.0, 0),
        rg.Point3d(-Hole_w/2.0, cy + Hole_h/2.0, 0),
        rg.Point3d(-Hole_w/2.0, cy - Hole_h/2.0, 0)
    ]
    holes.append(rg.Polyline(h_pts).ToNurbsCurve())
    
Piece_Curves = [outline] + holes
# ---------- end py3_3 ----------
n_piezas_3 = Slider(2, range=0..100)
boundary_2 = BoundarySurfaces(Edges=py3_3.Piece_Curves)  # -> flatten(Surfaces)
dup_3 = DuplicateData(Data=boundary_2, Number=n_piezas_3, Order=True)

# ---- group: PIEZA INTERIOR
n_piezas_4 = Slider(3, range=0..50)
py3_4 = Python3Script(
    T=number_slider_2,
    W_core=Slider(17.8, range=0..100),
    H_core=Slider(54, range=0..100),
    W_v=number_slider_3,
    H_h=Slider(12, range=0..100),
    C=Slider(0.5, range=0..1))  # -> out, Piece_Curve; inputs T: Double, W_core: Double, H_core: Double, W_v: Double, H_h: Double, C: Double
# ---------- py3_4: Python ----------
import Rhino.Geometry as rg

# 1. Aplicar holgura (C) a las espigas (pieza macho, por lo que restamos C)
w_v_adj = W_v - C
h_h_adj = H_h - C

# 2. Calcular mitades para simplificar las coordenadas desde el centro (0,0)
x_core = W_core / 2
y_core = H_core / 2
x_tab = w_v_adj / 2
y_tab = h_h_adj / 2

# 3. Definir los 20 puntos del perímetro (recorrido en sentido horario)
pts = []

# --- Espiga superior ---
pts.append(rg.Point3d(x_tab, y_core + T, 0))      # 1. Arriba derecha
pts.append(rg.Point3d(x_tab, y_core, 0))          # 2. Base espiga der

# --- Esquina superior derecha ---
pts.append(rg.Point3d(x_core, y_core, 0))         # 3. Hombro int der
pts.append(rg.Point3d(x_core, y_tab, 0))          # 4. Hombro ext der

# --- Espiga lateral derecha ---
pts.append(rg.Point3d(x_core + T, y_tab, 0))      # 5. Punta sup der
pts.append(rg.Point3d(x_core + T, -y_tab, 0))     # 6. Punta inf der

# --- Esquina inferior derecha ---
pts.append(rg.Point3d(x_core, -y_tab, 0))         # 7. Hombro ext inf der
pts.append(rg.Point3d(x_core, -y_core, 0))        # 8. Hombro int inf der

# --- Espiga inferior ---
pts.append(rg.Point3d(x_tab, -y_core, 0))         # 9. Base espiga inf der
pts.append(rg.Point3d(x_tab, -y_core - T, 0))     # 10. Abajo derecha
pts.append(rg.Point3d(-x_tab, -y_core - T, 0))    # 11. Abajo izquierda
pts.append(rg.Point3d(-x_tab, -y_core, 0))        # 12. Base espiga inf izq

# --- Esquina inferior izquierda ---
pts.append(rg.Point3d(-x_core, -y_core, 0))       # 13. Hombro int inf izq
pts.append(rg.Point3d(-x_core, -y_tab, 0))        # 14. Hombro ext inf izq

# --- Espiga lateral izquierda ---
pts.append(rg.Point3d(-x_core - T, -y_tab, 0))    # 15. Punta inf izq
pts.append(rg.Point3d(-x_core - T, y_tab, 0))     # 16. Punta sup izq

# --- Esquina superior izquierda ---
pts.append(rg.Point3d(-x_core, y_tab, 0))         # 17. Hombro ext izq
pts.append(rg.Point3d(-x_core, y_core, 0))        # 18. Hombro int izq

# --- Retorno a espiga superior ---
pts.append(rg.Point3d(-x_tab, y_core, 0))         # 19. Base espiga izq
pts.append(rg.Point3d(-x_tab, y_core + T, 0))     # 20. Arriba izquierda

# 4. Cerrar la geometría (conectar el último punto con el primero)
pts.append(pts[0])

# 5. Crear la curva y asignarla a la salida
Piece_Curve = rg.Polyline(pts).ToNurbsCurve()
# ---------- end py3_4 ----------
dup_4 = DuplicateData(Data=py3_4.Piece_Curve, Number=n_piezas_4, Order=True)

# ----
number_slider_11 = Slider(400, range=0..10000)
number_slider_12 = Slider(400, range=0..10000)

scale = Scale(Geometry=[dup, dup_4, dup_3, dup_2], Center=Point(0, 0, 0), Factor=Slider(1, range=0..10))  # -> Geometry, Transform

diámetro_de_fresa_cnc_mm = Slider(1, range=0..20)
rectangle = Rectangle(Plane=PlaneXY(0, 0, 0), XSize=number_slider_11, YSize=number_slider_12, Radius=0)  # -> Rectangle, Length
merge = Merge(Data1=scale.Geometry)  # -> flatten(Result)
boundary_3 = BoundarySurfaces(Edges=rectangle.Rectangle)
opennest1 = OpenNest1(
    Sheets=boundary_3,
    Geo=flatten(merge),
    Spacing=diámetro_de_fresa_cnc_mm,
    Placement=1,
    Tolerance=0.1,
    Rotations=4,
    Iterations=6,
    Seed=1,
    Reset=False,
    Run=Toggle(True))  # -> Sheets, Geo, ID, Transform, IDS
edges = BrepEdges(Brep=opennest1.Geo)  # -> Naked, Interior, NonManifold
flatten = FlattenTree(Tree=edges.Naked, Path="{0}")

py3_5 = Python3Script(Curvas=flatten, Ruta="C:/Users/janth/OneDrive/Escritorio/PIEZAS.dxf", Exportar=Button())  # -> out, a; inputs Curvas: list of GeometryBase
# ---------- py3_5: Python ----------
import os
import rhinoscriptsyntax as rs
import scriptcontext as sc
import Rhino

if "Exportar" in locals() and Exportar == True:
    if "Curvas" not in locals() or not Curvas:
        print("Error: Falta conectar el cable de las Curvas.")
    elif "Ruta" not in locals() or not Ruta:
        print("Error: Falta conectar el cable de la Ruta.")
    else:
        # 1. Limpiar el texto del panel por si hay espacios invisibles
        texto_ruta = str(Ruta).replace('\n', '').replace('\r', '').strip().replace('\\', '/')
        if not texto_ruta.lower().endswith('.dxf'):
            texto_ruta += '.dxf'

        # 2. SEPARAMOS LA CARPETA DEL NOMBRE DEL ARCHIVO
        carpeta = os.path.dirname(texto_ruta)
        nombre_archivo = os.path.basename(texto_ruta)

        # Verificar que la carpeta del panel realmente exista en tu PC
        if not os.path.exists(carpeta):
            print(f"Error: La carpeta no existe. Revisa que esté bien escrita:\n{carpeta}")
        else:
            sc.doc = Rhino.RhinoDoc.ActiveDoc
            rs.UnselectAllObjects()

            geometrias = Curvas if isinstance(Curvas, list) else [Curvas]
            ids_creados = []

            for geo in geometrias:
                if geo:
                    obj_id = sc.doc.Objects.Add(geo)
                    if obj_id:
                        ids_creados.append(obj_id)

            if ids_creados:
                rs.SelectObjects(ids_creados)
                sc.doc.Views.Redraw()

                # Borrar versión anterior para evitar que Rhino pregunte si deseas sobreescribir
                if os.path.exists(texto_ruta):
                    try:
                        os.remove(texto_ruta)
                    except Exception:
                        pass

                # 3. EL TRUCO: Cambiamos el directorio de trabajo de Rhino a tu escritorio
                rs.WorkingFolder(carpeta)

                # 4. Le damos la orden usando SOLO el nombre corto (igual que cuando funcionó con "true")
                cmd = f'! _-Export "{nombre_archivo}" _Enter _Enter'
                rs.Command(cmd, False)

                # Limpieza de la pantalla
                for i in ids_creados:
                    sc.doc.Objects.Delete(i, True)
                
                rs.UnselectAllObjects()
                sc.doc.Views.Redraw()

                # 5. Comprobación final
                if os.path.exists(texto_ruta):
                    print(f"¡AHORA SÍ!\nTu archivo está guardado en:\n{texto_ruta}")
                else:
                    print("Error: Rhino canceló. Presiona la tecla ESC 3 veces en Rhino y reintenta.")
            else:
                print("Error: Las curvas conectadas no son válidas.")
else:
    print("En reposo. Pulsa el botón para exportar.")
# ---------- end py3_5 ----------
panel = Panel(py3_5.out)

lng = ListLength(List=opennest1.Sheets)
len = Length(Curve=opennest1.Geo)
velocidad_de_corte_mm_min = Slider(150, range=0..10000)
ma = MassAddition(Input=flatten(len))  # -> Result, PartialResults
join = JoinCurves(Curves=flatten, Preserve=False)
# PERIMETRO DE PIEZAS TOTALES
panel_2 = Panel(ma.Result)
area = Area(Geometry=join)  # -> Area, Centroid
division = Division(A=ma.Result, B=velocidad_de_corte_mm_min)
multiplication = Multiplication(A=number_slider_11, B=number_slider_12)
ma_2 = MassAddition(Input=flatten(area.Area))  # -> Result, PartialResults
densidad_del_material_kg_m3 = Slider(700, range=0..1000)
panel_3 = Panel("TIEMPO DE CORTE")
panel_4 = Panel(division)
division_2 = Division(A=multiplication, B="1000000")
division_3 = Division(B="1000")
division_4 = Division(A="35000", B=division_2)
multiplication_2 = Multiplication(A=lng, B=division_2)
division_5 = Division(A=ma_2.Result, B="1000000")
costo_por_minuto = Slider(3000, range=0..10000)
multiplication_3 = Multiplication(A=division_3, B=division_5)
# PRECIO POR M2 DE PLANCHA
panel_5 = Panel(division_4)
division_6 = Division(A=division_5, B=multiplication_2)
# M2 NETOS DE LAS PIEZAS
panel_6 = Panel(division_5)
multiplication_4 = Multiplication(A=multiplication_3, B=densidad_del_material_kg_m3)
multiplication_5 = Multiplication(A=division_6, B="100")
panel_7 = Panel(multiplication_4)
multiplication_6 = Multiplication(A=panel_4, B=costo_por_minuto)
panel_8 = Panel("PESO (KG)")
multiplication_7 = Multiplication(A=panel_5, B=panel_6)
panel_9 = Panel(multiplication_5)
panel_10 = Panel("EFICIENCIA PLANCHA")
panel_11 = Panel(multiplication_6)
panel_12 = Panel("PRECIO DE PIEZAS")
panel_13 = Panel(multiplication_7)
subtraction = Subtraction(A="35000", B=multiplication_7)

py3_6 = Python3Script(
    Exportar=Button(),
    Ruta="C:/Users/janth/OneDrive/Escritorio/PIEZAS.dxf",
    Planchas=lng,
    CostoMerma=subtraction,
    Eficiencia=multiplication_5,
    Espesor=Slider(3, range=1..30))  # -> out, a; inputs Exportar: list of Boolean, Ruta: String
# ---------- py3_6: Python ----------
import os
import csv
from datetime import datetime

if "Exportar" in locals() and Exportar:
    if not Ruta:
        print("Error: Falta conectar la ruta.")
    else:
        ruta_str = str(Ruta).strip().strip('"').replace('\\', '/')
        ruta_csv = ruta_str.rsplit('.', 1)[0] + "_DATOS.csv"
        
        file_exists = os.path.isfile(ruta_csv)
        
        try:
            with open(ruta_csv, mode='a', newline='') as file:
                writer = csv.writer(file, delimiter=';') 
                
                # TÍTULOS: Se agrega la columna de Huella de Carbono
                if not file_exists:
                    writer.writerow(['Fecha y Hora', 'Planchas Usadas', 'Costo Compra (CLP)', 'Costo Merma (CLP)', 'Eficiencia (%)', 'CO2 Emitido por Merma (kg)'])
                
                fecha = datetime.now().strftime("%Y-%m-%d %H:%M")
                
                v_planchas = float(Planchas[0]) if isinstance(Planchas, list) else float(Planchas)
                v_compra = float(CostoCompra[0]) if isinstance(CostoCompra, list) else float(CostoCompra)
                v_merma = float(CostoMerma[0]) if isinstance(CostoMerma, list) else float(CostoMerma)
                v_eficiencia = float(Eficiencia[0]) if isinstance(Eficiencia, list) else float(Eficiencia)
                
                # --- MOTOR DE CÁLCULO AMBIENTAL ---
                v_co2 = 0.0
                if "AreaPlancha" in locals() and AreaPlancha and "Espesor" in locals() and Espesor:
                    v_area_plancha = float(AreaPlancha[0]) if isinstance(AreaPlancha, list) else float(AreaPlancha)
                    v_espesor = float(Espesor[0]) if isinstance(Espesor, list) else float(Espesor)
                    
                    # 1. Área total usada en m2 (el panel viene en mm2, lo dividimos por 1 millón)
                    area_total_m2 = (v_area_plancha / 1000000) * v_planchas
                    
                    # 2. Área de merma en m2 (el porcentaje ineficiente)
                    area_merma_m2 = area_total_m2 * (1 - (v_eficiencia / 100))
                    
                    # 3. Volumen de merma en m3 (el espesor viene en mm, lo dividimos por mil)
                    volumen_merma_m3 = area_merma_m2 * (v_espesor / 1000)
                    
                    # 4. Masa y Factor de Emisión (600 kg/m3 de densidad * 1.6 factor CO2)
                    masa_kg = volumen_merma_m3 * 600
                    v_co2 = masa_kg * 1.6
                
                # Ajuste de formatos (puntos por comas para el Excel chileno)
                str_planchas = str(round(v_planchas, 2)).replace('.', ',')
                str_compra = str(round(v_compra, 0)).replace('.', ',')
                str_merma = str(round(v_merma, 0)).replace('.', ',')
                str_eficiencia = str(round(v_eficiencia, 2)).replace('.', ',')
                str_co2 = str(round(v_co2, 2)).replace('.', ',')
                
                # Escribimos la fila completa con el dato ambiental
                writer.writerow([
                    fecha, 
                    str_planchas,
                    str_compra, 
                    str_merma, 
                    str_eficiencia,
                    str_co2
                ])
                
            print(f"¡CÁLCULO AMBIENTAL INTEGRADO!\nDatos guardados en:\n{ruta_csv}")
        except Exception as e:
            print(f"Error detallado: {e}")
else:
    print("En reposo. Pulsa el botón para registrar los datos.")
# ---------- end py3_6 ----------
panel_14 = Panel(py3_6.out)

panel_15 = Panel(subtraction)
panel_16 = Panel("COSTO MERMA")
